# Grasshopper definition geometric_environment.gh (Grasshopper 1.0.8)
# plug-ins: RhinoCodePluginGH

# ---- group: recaive generated script
python_3_script = Python3Script()  # -> udp_listener
# ---------- python_3_script: Python ----------
import socket


def udp_listener(worker):
    # Define the address and port to listen on
    server_address = ("localhost", 12346)

    # Create a UDP socket
    sock = socket.socket(socket.AF_INET, socket.SOCK_DGRAM)

    # Set the socket option to reuse the address
    sock.setsockopt(socket.SOL_SOCKET, socket.SO_REUSEADDR, 1)

    # Bind the socket to the server address
    sock.bind(server_address)

    worker.display_message("Listening for incoming UDP messages...")

    try:
        while True:
            # Check if worker has requested cancellation
            if worker.has_requested_cancellation():
                worker.display_message("Cancelling listener...")
                break

            # Receive message
            data, address = sock.recvfrom(
                65535
            )  # Buffer size max is 65535, typical is 4096 bytes
            message = data.decode()

            # Update the result with the received message
            worker.update_result(message)

            # Display the received message
            # worker.display_message("Received from %s:\n%s" % (str(address), message))
            worker.display_message("Received from %s" % (str(address)))

    except Exception as e:
        # Display the error message
        worker.display_message("Error: %s" % str(e))
        worker.update_result("Error: %s" % str(e))

    finally:
        # Ensure the socket is closed properly
        sock.close()
        worker.display_message("Listener stopped.")
# ---------- end python_3_script ----------
python_3_script_2 = Python3Script(task=python_3_script, reset=Button(), on=Toggle(True))  # -> out, result
# ---------- python_3_script_2: Python ----------
# from __future__ import absolute_import
# from __future__ import division
# from __future__ import print_function

import threading

import Grasshopper  # type: ignore
import Rhino
import scriptcontext
import System

# from compas_ghpython import create_id

# # COMPAS 1.x compatibility
# try:
#     from compas_ghpython.timer import update_component
# except ImportError:
#     from compas_ghpython import update_component



def create_id(component, name):
    """Creates an identifier string using `name` and the ID of the component passed to it.

    The resulting string can be used to store data elements in the global sticky dictionary.
    This can be useful when setting variable in a condition activated by a button.

    Parameters
    ----------
    components : `ghpythonlib.componentbase.executingcomponent`
        The components instance. Use `self` in advanced (SDK) mode and `ghenv.Components` otherwise.
    name : str
        A user chosen prefix for the identifier.

    Returns
    -------
    str
        For example: `somename55dd-c7cc-43c8-9d6a-65e4c8503abd`

    """
    return "{}_{}".format(name, component.InstanceGuid)


def update_component(ghenv, delay):
    """Schedule an update of the Grasshopper component.

    After the specified delay, the GH component will be automatically updated.

    Parameters
    ----------
    ghenv : :class:`GhPython.Component.PythonEnvironment`
        The current GHPython environment.
    delay : :obj:`int`
        Time in milliseconds until the update is performed.

    Raises
    ------
    ValueError
        If the delay is less than zero.

    """
    if delay <= 0:
        raise ValueError("Delay must be greater than zero")

    ghcomp = ghenv.Component
    ghdoc = ghcomp.OnPingDocument()

    def callback(ghdoc):
        if ghdoc.SolutionState != Grasshopper.Kernel.GH_ProcessStep.Process:
            ghcomp.ExpireSolution(False)

    ghdoc.ScheduleSolution(
        delay, Grasshopper.Kernel.GH_Document.GH_ScheduleDelegate(callback)
    )


class BackgroundWorker(object):
    """Background worker simplifies the creation of long-running tasks inside Grasshopper.

    A long-running task is any piece of code that will run for an extended period of time,
    for example, a very complex calculation, or loading a very large data file, etc.

    To use it, write your long-running function in a Grasshopper GHPython component,
    and pass it as the input to the background worker component.
    The worker will continue working without blocking the UI.

    The following is an example of a long-running function that updates the
    progress while it runs.

    .. code-block:: python

        import time

        def do_something_long_and_complicated(worker):
            # Result can be of any data type
            result = 0

            for i in range(50):
                worker.current_value = i
                result += i
                worker.display_progress(i / (50-1))
                time.sleep(0.01)

            worker.display_message("Done!")

            return result


    Parameters
    ----------
    ghenv : ``GhPython.Component.PythonEnvironment``
        Grasshopper environment object
    long_running_function : function, optional
        This function will be the main entry point for the long-running task.
    dispose_function : function, optional
        If defined, this function will be called when the worker is disposed. It can be used for clean-up tasks
        and resource deallocation.
    auto_set_done : bool, optional
        If true, the worker state will be automatically set to ``Done`` after the function returns.
        Defaults to ``True``.
    args : tuple, optional
        List or tuple of arguments for the invocation of the ``long_running_function``. Defaults to ``()``.
    """

    def __init__(
        self,
        ghenv,
        long_running_function=None,
        dispose_function=None,
        auto_set_done=True,
        args=(),
    ):
        super(BackgroundWorker, self).__init__()
        self.ghenv = ghenv
        self._is_working = False
        self._is_done = False
        self._is_cancelled = False
        self._has_requested_cancellation = False
        self.long_running_function = long_running_function
        self.dispose_function = dispose_function
        self.auto_set_done = auto_set_done
        self.args = args

    def is_working(self):
        """Indicate whether the worker is currently working or not."""
        return self._is_working

    def is_done(self):
        """Indicate whether the worker is done or not."""
        return self._is_done

    def has_requested_cancellation(self):
        return self._has_requested_cancellation

    def request_cancellation(self):
        """Mark the current worker as cancelled, so that the background task can stop processing."""
        self._has_requested_cancellation = True

    def start_work(self):
        """Start the background processing thread where work will be performed."""

        def _long_running_task_wrapper(worker):
            try:
                worker.set_internal_state_to_working()
                result = self.long_running_function(self, *self.args)

                # There are (at least) two types of long running functions:
                # 1. Those that block the thread while working
                #    (e.g. they have a busy-wait or some kind of `while` loop)
                # 2. Those that hookup event handlers and return immediately
                #    so then they don't need to block the thread.
                # The first case means that we can set the state to "DONE"
                # right after calling the function because if it returned, it really
                # means it's done.
                # The second case will return immediately, and setting the state to "DONE"
                # would be wrong because the handlers are still going to trigger.
                # In that case we can set the flag `auto_set_done` to `False` so that
                # we don't automatically set the state to "DONE".
                if self.auto_set_done:
                    worker.set_internal_state_to_done(result)
            except Exception as e:
                worker.display_message(str(e))
                worker.set_internal_state_to_cancelled()

        target = _long_running_task_wrapper
        args = (self,)
        self.thread = threading.Thread(target=target, args=args)
        self.thread.daemon = True
        self.thread.start()

    def dispose(self):
        """Invoked when the worker is being disposed."""
        if callable(self.dispose_function):
            self.dispose_function(self)

    def set_internal_state_to_working(self):
        """Set the internal state to ``working``."""
        self._is_working = True
        self._is_done = False
        self._is_cancelled = False

    def set_internal_state_to_done(self, result):
        """Set the internal state to ``done``, which indicates the worker has completed."""
        self._is_working = False
        self._is_done = True
        self._is_cancelled = False
        self.update_result(result, delay=1)

    def update_result(self, result, delay=1):
        """Update the result of the worker.

        This will update the result of the worker, and trigger a solution expiration
        of the Grasshopper component.

        Parameters
        ----------
        result : object
            Result of the worker.
        delay : int, optional
            Delay (in milliseconds) before updating the component, by default 1.
        """
        self.result = result
        update_component(self.ghenv, delay)

    def set_internal_state_to_cancelled(self):
        """Set the internal state to ``cancelled``."""
        self._is_working = False
        self._is_done = False
        self._is_cancelled = True

    def display_progress(self, progress):
        """Display a progress indicator in the component.

        Parameters
        ----------
        progress : float
            Float between ``0..1`` indicating progress of completion.
        """
        self.display_message("Progress {:.1f}%".format(progress * 100))

    def display_message(self, message):
        """Display a message in the component without triggering a solution expiration.

        Parameters
        ----------
        message : str
            Message to display.

        """

        def ui_callback():
            self.ghenv.Component.Message = message
            self.ghenv.Component.OnDisplayExpired(True)

        Rhino.RhinoApp.InvokeOnUiThread(System.Action(ui_callback))

    @classmethod
    def instance_by_component(
        cls,
        ghenv,
        long_running_function=None,
        dispose_function=None,
        auto_set_done=True,
        force_new=False,
        args=(),
    ):
        """Get the worker instance assigned to the component.

        This will get a persistant instance of a background worker
        for a given component. The parameter `force_new` can
        be set to `True` to request a new instance to be created.

        Parameters
        ----------
        ghenv : ``GhPython.Component.PythonEnvironment``
            Grasshopper environment object
        long_running_function : function, optional
            This function will be the main entry point for the long-running task.
        dispose_function : function, optional
            If defined, this function will be called when the worker is disposed.
            It can be used for clean-up tasks and resource deallocation.
        auto_set_done : bool, optional
            If true, the worker state will be automatically set to ``Done`` after the function returns.
            Defaults to ``True``.
        force_new : bool, optional
            Force the creation of a new background worker, by default False.
        args : tuple, optional
            List or tuple of arguments for the invocation of the ``long_running_function``. Defaults to ``()``.

        Returns
        -------
        :class:`BackgroundWorker`
            Instance of the background worker of the current component.
        """

        key = create_id(ghenv.Component, "background_worker")
        worker = scriptcontext.sticky.get(key)

        if worker and force_new:
            worker.request_cancellation()
            worker.dispose()
            worker = None
            del scriptcontext.sticky[key]

        if not worker:
            worker = cls(
                ghenv,
                long_running_function=long_running_function,
                dispose_function=dispose_function,
                auto_set_done=auto_set_done,
                args=args,
            )
            scriptcontext.sticky[key] = worker

        return worker

    @classmethod
    def stop_instance_by_component(cls, ghenv):
        """Stops the worker instance assigned to the component.

        If there is no worker running, it will do nothing.

        Parameters
        ----------
        ghenv : ``GhPython.Component.PythonEnvironment``
            Grasshopper environment object
        """

        key = create_id(ghenv.Component, "background_worker")
        worker = scriptcontext.sticky.get(key)

        if worker:
            worker.request_cancellation()
            worker.dispose()
            worker = None
            del scriptcontext.sticky[key]


import threading

# import scriptcontext as sc

# from compas_eve.ghpython import BackgroundWorker
# from ghpythonlib.componentbase import executingcomponent as component


DEBUG = False


class MyComponent(Grasshopper.Kernel.GH_ScriptInstance):
    def RunScript(self, task, reset, on):
        if not on:
            BackgroundWorker.stop_instance_by_component(ghenv)  # noqa: F821
            return None

        self.worker = BackgroundWorker.instance_by_component(ghenv, task, force_new=reset)  # noqa: F821

        if not self.worker.is_working() and not self.worker.is_done() and reset:
            self.worker.start_work()

        print("Worker ID: {}".format(id(self.worker)))
        print("Is worker running? {}".format(self.worker.is_working()))
        print("Worker completed? {}".format(self.worker.is_done()))
        if hasattr(self.worker, "thread"):
            print("Worker thread: {}".format(self.worker.thread))

        if DEBUG:
            other_workers = []
            for key in scriptcontext.sticky.keys():
                if key.startswith("background_worker_"):
                    worker = scriptcontext.sticky[key]
                    if worker != self.worker:
                        other_workers.append(worker)

            if len(other_workers):
                print
                print("Found {} more workers:".format(len(other_workers)))
                for worker in other_workers:
                    print("* Worker ID: {}".format(id(worker)))
                    print(" - Is worker running? {}".format(worker.is_working()))
                    print(" - Worker completed? {}".format(worker.is_done()))
                    print(" - Worker thread: {}".format(worker.thread))

            non_main_threads = [thread for thread in threading.enumerate() if thread.name != "MainThread"]
            if len(non_main_threads):
                print
                print("Found {} background threads running:".format(len(non_main_threads)))
                for thread in non_main_threads:
                    print(" - " + thread.name)

        if hasattr(self.worker, "result"):
            return self.worker.result
        else:
            return None
# ---------- end python_3_script_2 ----------
panel = Panel(python_3_script_2.out)
text = Text(python_3_script_2.result)
panel_2 = Panel(text)

# ---- group: use for manual loading of scripts
python_3_script_3 = Python3Script()  # -> out, geometry_states; disabled
# ---------- python_3_script_3: Python ----------
# Created for 0007_0003_rippled_grid.json

""" Summary:
The function `create_rippled_grid_concept_model` generates an architectural concept model inspired by the "rippled grid" metaphor. It constructs a grid of points where each point's height is influenced by a sine wave formula, simulating a dynamic, undulating surface that represents the ripple effect. This approach captures the interplay between structured order and fluid movement, aligning with the design task's requirements. By varying parameters like ripple amplitude and frequency, the model showcases rhythmic patterns and spatial variations, while maintaining visibility of the underlying grid. The resulting geometries embody both fluidity and cohesion, reflecting the metaphor's essence."""

#! python 3
function_code = """def create_rippled_grid_concept_model(grid_size, grid_spacing, ripple_amplitude, ripple_frequency, plane_height, seed=42):
    \"""
    Creates an architectural Concept Model embodying the 'rippled grid' metaphor using a series of undulating planes.
    
    The model features a dynamic, rhythmic pattern where the surfaces ripple across a regular grid, implying movement 
    and flow while maintaining structural order. The spaces within reflect the expansion and contraction suggested by 
    the ripples.

    Parameters:
    - grid_size (int): The number of divisions in the grid (e.g., 10 for a 10x10 grid).
    - grid_spacing (float): The distance between grid lines in meters.
    - ripple_amplitude (float): The maximum height variation of the ripple in meters.
    - ripple_frequency (float): The frequency of the ripple effect.
    - plane_height (float): The height at which each plane is positioned in meters.
    - seed (int, optional): Seed for the random number generator to ensure replicable results. Default is 42.
    
    Returns:
    - List[Rhino.Geometry.Brep]: A list of Brep geometries representing the undulating planes.
    \"""
    import Rhino.Geometry as rg
    import random
    import math

    # Set the seed for randomness
    random.seed(seed)
    
    # List to store the resulting Breps
    breps = []

    # Create the base grid of points
    for i in range(grid_size):
        for j in range(grid_size):
            # Calculate the x, y position based on the grid
            x = i * grid_spacing
            y = j * grid_spacing

            # Calculate the z position using a sine wave pattern for the ripple effect
            z = ripple_amplitude * math.sin(ripple_frequency * (x + y))

            # Create a series of points along the z-axis to form the ripple effect
            points = []
            for k in range(-grid_size // 2, grid_size // 2):
                z_offset = ripple_amplitude * math.sin(ripple_frequency * (x + y + k))
                points.append(rg.Point3d(x, y, plane_height + z_offset))

            # Create a NURBS curve through the points
            curve = rg.Curve.CreateInterpolatedCurve(points, 3)

            # Create a surface by extruding the curve along the y-axis
            if curve:
                extrusion = rg.Extrusion.Create(curve, grid_spacing * grid_size, True)
                if extrusion:
                    surface = extrusion.ToBrep()
                    if surface:
                        # Convert the surface to a Brep and add it to the list
                        breps.append(surface)

    return breps"""

try:
    exec(function_code)
    import ghpythonlib.treehelpers as th
    from Grasshopper.Kernel.Data import GH_Path
    geometry_states = []
    # Generate sample geometry 1/5
    geometry = create_rippled_grid_concept_model(grid_size=10, grid_spacing=1.0, ripple_amplitude=0.5, ripple_frequency=2.0, plane_height=0.0)
    geometry = list(geometry) if not isinstance(geometry, list) else geometry
    geometry_states.append(geometry)

    # Generate sample geometry 2/5
    geometry = create_rippled_grid_concept_model(grid_size=15, grid_spacing=0.5, ripple_amplitude=1.0, ripple_frequency=1.5, plane_height=2.0)
    geometry = list(geometry) if not isinstance(geometry, list) else geometry
    geometry_states.append(geometry)

    # Generate sample geometry 3/5
    geometry = create_rippled_grid_concept_model(grid_size=8, grid_spacing=2.0, ripple_amplitude=0.3, ripple_frequency=3.0, plane_height=1.0)
    geometry = list(geometry) if not isinstance(geometry, list) else geometry
    geometry_states.append(geometry)

    # Generate sample geometry 4/5
    geometry = create_rippled_grid_concept_model(grid_size=12, grid_spacing=1.5, ripple_amplitude=0.7, ripple_frequency=2.5, plane_height=1.5)
    geometry = list(geometry) if not isinstance(geometry, list) else geometry
    geometry_states.append(geometry)

    # Generate sample geometry 5/5
    geometry = create_rippled_grid_concept_model(grid_size=20, grid_spacing=0.8, ripple_amplitude=0.4, ripple_frequency=1.0, plane_height=3.0)
    geometry = list(geometry) if not isinstance(geometry, list) else geometry
    geometry_states.append(geometry)

    # Convert the list of geometries to a Grasshopper DataTree
    geometry_states = th.list_to_tree(geometry_states)

    print("success")
except Exception as e:
    print("Error: ", e)
# ---------- end python_3_script_3 ----------
geometry = Geometry(python_3_script_3.geometry_states)  # disabled
brep = Brep(python_3_script_3.geometry_states)  # disabled
panel_3 = Panel(python_3_script_3.geometry_states)  # disabled

# ---- group: run generated script
python_3_script_4 = Python3Script(script=text)  # -> out, geometry_states; unedited script template

# ---- group: the produced geometry
geometry_2 = Geometry(python_3_script_4.geometry_states)

# ----
panel_4 = Panel(python_3_script_4.out)
brep_2 = Brep(geometry_2)
bounding_box = BoundingBox(Content=brep_2, Plane=PlaneXY(0, 0, 0), UnionBox=True)  # -> Box, Box_2
box_properties = BoxProperties(Box=bounding_box.Box)  # -> Center, Diagonal, Area, Volume, Degeneracy
null_item = NullItem(Item=brep_2)  # -> NullFlags, InvalidFlags, Description
vector_length = VectorLength(Vector=box_properties.Diagonal)
cull_pattern = CullPattern(List=brep_2, CullPattern=invert(null_item.NullFlags))
multiplication = Multiplication(A=vector_length, B=Slider(0.001, range=0..0.01))
solid_union = SolidUnion(Breps=cull_pattern)  # disabled
panel_5 = Panel(vector_length)
settings_custom = SettingsCustom(
    StitchSeams=True,
    SimplePlanes=False,
    Refine=True,
    MinCount=16,
    MaxCount=400,
    AspectRatio=20,
    MaxDistance=0,
    MaxAngle=20,
    MinEdge=multiplication,
    MaxEdge=0)
mesh_brep = MeshBrep(Brep=cull_pattern, Settings=settings_custom)
mesh = Mesh(mesh_brep)
mesh_join = MeshJoin(Meshes=mesh)
python_3_script_5 = Python3Script(mesh=mesh_join)  # -> out, obj_file_path; inputs mesh: tree of Mesh
# ---------- python_3_script_5: Python ----------
import os

import Grasshopper
import Rhino
import System
from Rhino.FileIO import FileObj, FileObjWriteOptions, FileWriteOptions


class MyComponent(Grasshopper.Kernel.GH_ScriptInstance):
    def RunScript(self, mesh: Grasshopper.DataTree[Rhino.Geometry.Mesh]):

        # set the write options
        write_options = FileWriteOptions()
        write_options.WriteSelectedObjectsOnly = True
        write_options.SuppressDialogBoxes = True
        # https://developer.rhino3d.com/api/rhinocommon/rhino.fileio.fileobjwriteoptions
        obj_options = FileObjWriteOptions(write_options)
        obj_options.CullUnnecessaryVertexesInNgons = True
        obj_options.EolType = FileObjWriteOptions.AsciiEol.Crlf
        obj_options.ExportAsTriangles = False
        # obj_options.ExportGroupNameLayerNames = FileObjWriteOptions.ObjGroupNames.NoGroups
        obj_options.ExportMaterialDefinitions = False
        obj_options.ExportNormals = False
        # obj_options.ExportObjectNames = FileObjWriteOptions.ObjObjectNames.NoObjects
        obj_options.ExportOpenMeshes = True
        obj_options.ExportTcs = False
        obj_options.ExportVcs = False
        obj_options.UseSimpleDialog = False
        obj_options.IncludeUnweldedEdgesInNgons = False
        obj_options.MapZtoY = True
        obj_options.MeshType = FileObjWriteOptions.VertexWelding.Normal
        obj_options.ObjectType = FileObjWriteOptions.GeometryType.Mesh
        obj_options.SignificantDigits = 16
        obj_options.WrapLongLines = False

        # get current gresshopper definition path
        file_name = ghenv.Component.OnPingDocument().FilePath
        # print(file_name)
        # get the directory of the file
        dir_name = os.path.dirname(file_name)
        # Create a list to store the file paths of generated obj files
        obj_file_paths = []

        # Loop through each path in the DataTree
        for i, path in enumerate(mesh.Paths):
            # Get the mesh at the current path
            mesh_list = mesh.Branch(path)

            # If the branch contains meshes, proceed with export
            if mesh_list:
                # Create the file name with the index padded to 2 digits
                padded_index = str(i).zfill(2)
                file_name = f"mesh_{padded_index}.obj"
                full_path = os.path.join(dir_name, file_name)

                # Write the mesh to the file
                FileObj.Write(full_path, meshes=list(mesh_list), options=obj_options)

                # Add the file path to the list
                obj_file_paths.append(full_path)

        # Output the list of generated file paths
        return obj_file_paths
# ---------- end python_3_script_5 ----------
panel_6 = Panel(mesh_join)

# ---- group: send result/errors to agent
python_3_script_6 = Python3Script(messages=python_3_script_4.out, obj_str=python_3_script_5.obj_file_path)  # -> out, a; inputs messages: list, obj_str: list of String
# ---------- python_3_script_6: Python ----------
import json
import socket

import Grasshopper
import System


def send_data(data):
    # Create a UDP socket
    udp_socket = socket.socket(socket.AF_INET, socket.SOCK_DGRAM)
    server_address = ("localhost", 12347)
    udp_socket.sendto(data, server_address)
    # s.send(data)
    udp_socket.close()


class MyComponent(Grasshopper.Kernel.GH_ScriptInstance):
    def RunScript(self,
            messages: System.Collections.Generic.List[object],
            obj_str: System.Collections.Generic.List[str]):
        if messages is None:
            return None

        script_log_data = "\n".join(messages)
        # obj_data = obj_str.encode()
        data = {
            "script_log": script_log_data,
            "obj_file_paths": list(obj_str),
        }
        data = json.dumps(data)
        send_data(data.encode())
        a = data
        return data
# ---------- end python_3_script_6 ----------
panel_7 = Panel(python_3_script_6.a)
